# Dynamo graph API.dyn (Dynamo 1.3.3.4111)

current = Document.Current()
filePath = Document.FilePath(current)
directoryName = FilePath.DirectoryName(filePath)
boolean = BoolSelector(false)
fileName = FilePath.FileName(filePath, boolean)
string = StringInput("")
code_block = CodeBlock(filePath=directoryName, fileName=fileName, fileExtension=string) { filePath; fileName; fileExtension; filePath + "\\" + fileName + fileExtension; }
exists = File.Exists(code_block.fileExtension)
fromPath = FileObject(code_block.fileExtension)  # "File.FromPath"
string_from_object = FromObject(fromPath)
if_ = If(test=exists, true=code_block.fileExtension, false=string_from_object)

# group: 1. 모델 선택창에서 선택을 누른다. 2. 선택할 모델들을 드래그한다. 3. 정상적으로 선택되었다면 모델들의 인스턴스 아이디들이 박스 안에 담기게된다. 4. 창 7시방향에 위치한 실행 버튼을 누른다. 5. 시간이 많이 걸릴 수 있으므로 기다린다. 6. 성공적으로 추출되었으면 레빗파일의 같은 디렉토리 안에 txt 파일이 생성이 되거나, 덮어 씌어진다.
모델_선택하기 = DSModelElementsSelection()

code_block_2 = CodeBlock(path=if_, element=모델_선택하기) { path; element; return = element != null ? path : null; }
parameters = Element.Parameters(모델_선택하기)
id = Element.Id(모델_선택하기)
getCategory = Element.GetCategory(모델_선택하기)
id_2 = Category.Id(getCategory)
parameterToString = MyPlugin.JeongYireRevitAPI.ParameterToString(parameters, id, id_2)
string_from_array = FromArray(parameterToString)
code_block_3 = CodeBlock { 1; }
length = String.Length(string_from_array)
code_block_4 = CodeBlock(a=length) { a - 2; }
substring = String.Substring(str=string_from_array, startIndex=code_block_3, length=code_block_4)
code_block_5 = CodeBlock(a=substring) { a; "["+a+"]"; }
writeText = File.WriteText(code_block_2.out2, code_block_5.out1)
